# Grasshopper definition Viewshed.gh (Grasshopper 0.9.76)
# plug-ins: Python Interpreter

pt = Point([<point referenced from the Rhino model> x3])
brep = Brep([<brep referenced from the Rhino model> x14])
ladybug = Ladybug_Ladybug()  # -> Vviiiiiiiiiizzz; plug-in component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
honeybee = Honeybee_Honeybee()  # -> Vviiiiiiiiiizzz; plug-in component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
indoorviewfactor = Honeybee_IndoorViewFactorCalculator()  # -> readMe, port, viewFactorMesh, viewFactorInfo, port_2, testPts, viewMeshFaces, zoneWireFrame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; plug-in component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
mesh = Mesh(pt=pt, surfaces=brep, precision="0.15")  # -> vfs_3, meshes_2, circles_2, col_2
boolean = Boolean(pt=pt, surfaces=brep)  # -> vfs_2, srf_2, col_2
python = PythonScript(fname="Honeybee_GeometricViewFactor.py")  # -> fout
# ---------- python: Python ----------
import os

if ghdoc.Path:
    fdir = os.path.dirname(ghdoc.Path)
    fout = os.path.join(fdir,fname)
# ---------- end python ----------
file = ReadFile(File=python, PerLineParse=False)
ma = MassAddition(Input=boolean.vfs_2)  # -> Result, PartialResults
preview = CustomPreview(Geometry=boolean.srf_2, Shader=boolean.col_2)
error = Error(act=boolean.vfs_2)  # -> error_range_2, rms_error_2
path_mapper = PathMapper(mesh.vfs_3, source="{A;B}", target="{A}")
mesh_2 = Mesh(mesh.meshes_2)
preview_2 = CustomPreview(Geometry=mesh.circles_2, Shader=ColourSwatch(SwatchColor=RGB(0, 0, 0)))
panel = Panel(ma.Result)
panel_2 = Panel([error.error_range_2, error.rms_error_2])
indoorviewfactor_2 = Honeybee_IndoorViewFactorCalculator(Code=file, _srf_lst=brep, _pt_lst=pt, _grid_size=Slider(1, range=0..1), _runIt=Toggle(True))  # -> ReadMe, ViewVectors, Debug
ma_2 = MassAddition(Input=path_mapper)  # -> Result, PartialResults
panel_3 = Panel(ma_2.Result)
splitmass = Honeybee_SplitBuildingMass()  # -> readMe, splitBldgMasses; plug-in component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
panel_4 = Panel(indoorviewfactor_2.ViewVectors)
panel_5 = Panel(indoorviewfactor_2.Debug)

# ==== cluster Boolean
surfaces = ClusterInput()
pt = ClusterInput()
surfaces_2 = Brep(surfaces)
pt_2 = Point(pt)
mesh = MeshBrep(
    Brep=surfaces_2,
    Settings={GridMaxCount=0, GridMinCount=16, JaggedSeams=False, MaxEdgeLength=0, MinEdgeLength=0.0001, MinTolerance=0, Refine=True, RefineAngle=0, RelativeTolerance=0.65, SimplePlanes=True, Tolerance=0})
faceb = FaceBoundaries(Mesh=mesh)  # -> simplify(graft(Boundaries))
rhatt = GetRhinoAttributes(Geometry=surfaces_2)  # -> Name, Layer, Colour
sph = Sphere(Base=pt_2, Radius=1)
extr = ExtrudePoint(Base=faceb, Point=pt_2)
cap = CapHoles(Brep=extr)
sint = SolidIntersection(BrepsA=sph, BrepsB=cap)
debrep = DeconstructBrep(Brep=sint)  # -> simplify(graft(Faces)), Edges, Vertices
debrep_2 = DeconstructBrep(Brep=debrep.Faces)  # -> Faces, Edges, Vertices
cp = ClosestPoint(Point=pt_2, Cloud=debrep_2.Vertices)  # -> ClosestPoint, CPIndex, simplify(Distance)
cull = CullPattern(List=debrep.Faces, CullPattern=cp.Distance)
path_mapper = PathMapper(cull, source="{A;B;C}", target="{A}")
srf = Surface(path_mapper)
area = Area(Geometry=srf)  # -> Area, Centroid
ma = MassAddition(Input=area.Area)  # -> Result, PartialResults
path_mapper_2 = PathMapper(ma.Result, source=["{A;B}", "{A}"], target=["{A}", "{0}"])
col = Colour(graft(rhatt.Colour))
division = Division(A=path_mapper_2, B=12.56637061)
vfs = Number(division)
srf_2 = ClusterOutput(srf)
col_2 = ClusterOutput(col)
vfs_2 = ClusterOutput(vfs)
preview = CustomPreview(Geometry=srf, Shader=col)

# ==== cluster Mesh
pt = ClusterInput()
surfaces = ClusterInput()
precision = ClusterInput()
surfaces_2 = Brep(surfaces)
precision_2 = Number(precision)
pt_2 = Point(pt)
brep_cp = BrepClosestPoint(Point=graft(pt_2), Brep=surfaces_2)  # -> Point, Distance
multiplication = Multiplication(A=brep_cp.Distance, B=precision_2)
geo = Geometry(brep_cp.Point)
custom_mesh_settings = SettingsCustom(
    StitchSeams=True,
    SimplePlanes=False,
    Refine=True,
    MinCount=16,
    MaxCount=400,
    AspectRatio=20,
    MaxDistance=0,
    MaxAngle=20,
    MinEdge=multiplication,
    MaxEdge=multiplication)
mesh = MeshBrep(Brep=surfaces_2, Settings=simplify(custom_mesh_settings))
jagged = SettingsSpeed()
mesh_2 = Mesh(mesh)
mesh_3 = MeshBrep(Brep=surfaces_2, Settings=jagged)
explode = MeshExplode(Mesh=mesh_2, Interpolate=False)
facen = FaceNormals(Mesh=mesh_2)  # -> Centers, Normals
mjoin = MeshJoin(Meshes=mesh_3)
area = MeshArea(Mesh=explode)  # -> Area, Centroid
c_script = CSharpScript(Points=pt_2, Occlusion=mjoin, MeshFaceCenters=facen.Centers, MeshFaceNormals=facen.Normals, MeshFaceAreas=area.Area)  # -> out, A, B, C; inputs Points: list of Point3d, Occlusion: Mesh, MeshFaceCenters: tree of Point3d, MeshFaceNormals: tree of Vector3d, MeshFaceAreas: tree of Double
# ---------- c_script: C# ----------
    DataTree<Point3d> outputCenters = new DataTree<Point3d>();
    DataTree<Vector3d> outputVectors = new DataTree<Vector3d>();

    DataTree<double> factors = new DataTree<double>();
    DataTree<double> circles = new DataTree<double>();

    for (int i = 0; i < MeshFaceCenters.BranchCount; i++)
    {
      GH_Path path = MeshFaceCenters.Path(i);
      int pointId = path.Indices[0];
      int meshId = path.Indices[1];
      Point3d p = Points[pointId];
      int faceId = 0;
      MeshFaceCenters.Branch(i).ForEach(center => {
        if (visible(p, center, Occlusion)){
          Vector3d vec = new Vector3d(center.X - p.X, center.Y - p.Y, center.Z - p.Z);

          Vector3d norm = MeshFaceNormals.Branch(i)[faceId];
          vec.Unitize();
          norm.Unitize();

          double distance = p.DistanceTo(center);
          double area = MeshFaceAreas.Branch(i)[faceId];
          double cosTh = Math.Abs(vec.X * norm.X + vec.Y * norm.Y + vec.Z * norm.Z);
          double factor = cosTh * area / (distance * distance);
          Point3d outPt = Point3d.Add(p, vec);

          factors.Add(factor, path);
          outputCenters.Add(outPt, path);
          outputVectors.Add(vec, path);
        }
        faceId++;
        });
    }

   
    A = outputCenters;
    B = outputVectors;
    C = factors;
# ---------- c_script: C# additional code ----------
  public static bool visible(Point3d start, Point3d end, Mesh mesh)
  {
    Line line = new Line(start, end);
    int[] faces;
    Point3d[] intersections = Rhino.Geometry.Intersect.Intersection.MeshLine(mesh, line, out faces);
    //if (faces == null) return true;
    if (intersections.Length < 2) return true;
    else{
      bool visible = true;
      double distance = start.DistanceTo(end);
      for (int i = 0; i < intersections.Length; i++)
      {
        Point3d center = intersections[i];
        double distToStart = center.DistanceTo(start);
        double distToEnd = center.DistanceTo(end);
        if (distToStart < distance && distToEnd < distance)
        {
          // point is in between and hence face occludes
          visible = false;
          i = faces.Length;
        }
      }
      return visible;
    }
  }


  public static Point3d getMeshFaceCenter(Mesh mesh, int j)
  {
    try
    {
      return AreaMassProperties.Compute(faceOfMesh(mesh, j)).Centroid;
    }
    catch
    {
      return new Point3d();
    }
  }

  public static double getMeshFaceArea(Mesh mesh, int j)
  {
    try
    {
      return AreaMassProperties.Compute(faceOfMesh(mesh, j)).Area;
    }
    catch
    {
      return 1.0;
    }
  }

  private static void computeFaceNormals(Mesh mesh)
  {
    mesh.FaceNormals.ComputeFaceNormals();
  }

  private static Mesh faceOfMesh(Mesh mesh, int j)
  {
    Mesh newMesh = new Mesh();
    newMesh.Vertices.Add(mesh.Vertices[mesh.Faces[j].A]);
    newMesh.Vertices.Add(mesh.Vertices[mesh.Faces[j].B]);
    newMesh.Vertices.Add(mesh.Vertices[mesh.Faces[j].C]);
    if (mesh.Faces[j].IsQuad)
    {
      newMesh.Vertices.Add(mesh.Vertices[mesh.Faces[j].D]);
      newMesh.Faces.AddFace(0, 1, 2, 3);
    }
    else
    {
      newMesh.Faces.AddFace(0, 1, 2);
    }
    return newMesh;
  }
# ---------- end c_script ----------
path_mapper = PathMapper(c_script.C, source="{A;B}", target="{A}")
pi = Pi(Factor=1)
ma = MassAddition(Input=path_mapper)  # -> Result, PartialResults
division = Division(A=c_script.C, B=pi)
division_2 = Division(A=c_script.C, B=12.56637061)
sqrt = SquareRoot(Value=division)
vfs = Number(division_2)
circle = CircleCNR(Center=c_script.A, Normal=c_script.B, Radius=sqrt)
ma_2 = MassAddition(Input=vfs)  # -> Result, PartialResults
polygon = Polygon(Plane=PlaneXY(0, 0, 0), Radius=1, Segments=12, FilletRadius=0)  # -> Polygon, Length
darc = DeconstructArc(Arc=circle)  # -> BasePlane, Radius, Angle
path_mapper_2 = PathMapper(circle, source="{A;B}", target="{B}")
cir = Circle(Plane=PlaneXY(0, 0, 0), Radius=1)
mesh_4 = MeshBrep(
    Brep=polygon.Polygon,
    Settings={GridMaxCount=0, GridMinCount=16, JaggedSeams=False, MaxEdgeLength=0, MinEdgeLength=0.0001, MinTolerance=0, Refine=True, RefineAngle=0, RelativeTolerance=0.65, SimplePlanes=True, Tolerance=0})
rhatt = GetRhinoAttributes(Geometry=surfaces_2)  # -> Name, Layer, Colour
scale = Scale(Geometry=mesh_4, Center=Point(0, 0, 0), Factor=darc.Radius)  # -> Geometry, Transform
col = Colour(graft(rhatt.Colour))
orient = Orient(Geometry=scale.Geometry, Source=PlaneXY(0, 0, 0), Target=darc.BasePlane)  # -> Geometry, Transform
path_mapper_3 = PathMapper(orient.Geometry, source="{A;B}", target="{B}")
mcol = MeshColours(Mesh=path_mapper_3, Colours=col)
vfs_2 = Number(ma_2.Result)
circles = Circle(path_mapper_2)
meshes = Mesh(mcol)
preview = CustomPreview(Geometry=circles, Shader=col)
meshes_2 = ClusterOutput(meshes)
circles_2 = ClusterOutput(circles)
vfs_3 = ClusterOutput(vfs_2)
col_2 = ClusterOutput(col)

# ==== cluster Error
act = ClusterInput()
approx = ClusterInput()
act_2 = Number(act)
approx_2 = Number(approx)
subtraction = Subtraction(A=act_2, B=approx_2)
sqr = Square(Value=subtraction)
avr = Average(Input=sqr)
bnd = Bounds(Numbers=subtraction)
sqrt = SquareRoot(Value=avr)
error_range = Domain(bnd)
rms_error = Number(sqrt)
error_range_2 = ClusterOutput(error_range)
rms_error_2 = ClusterOutput(rms_error)
